# Grasshopper definition TurtleShell.gh (Grasshopper 1.0.7)
# plug-ins: LunchBox, GH TSD, Kangaroo2 Components

steel_column_length = Slider(1, range=1..10)
column_height = Slider(19, range=3..50)
number_of_secondary_trusses = Slider(3, range=0..60)
number_of_primary_trusses = Slider(6, range=0..60)
outer_radius = Slider(32, range=0..100)
edge_truss_depth = Slider(0.5, range=0..5)
truss_depth = Slider(2, range=0..10)
offset_circles_x = Slider(1.5, range=0..10)
inner_radius_2 = Slider(17, range=0..100)
inner_radius_3 = Slider(9, range=0..100)
inner_radius = Slider(28, range=0..100)

# ---- group: Geometry
# Moved torus to 0,0,0
# Origninal Torus is here
number_slider = Slider(12, range=0..30)
unit_y = UnitY(Factor=1)
torus_surface = TorusSurface(
    UDivisions=90,
    VDivisions=96,
    CParameter=number_slider,
    RParameter=Slider(8.32, range=0..100),
    TParameter=1,
    Scale=5,
    Domain1=Domain(0, 6.283185307),
    Domain2=Domain(-3.141592654, 3.141592654))
rotate_3d = Rotate3D(Geometry=torus_surface, Angle=1.570796327, Center=Point(0, 0, 0), Axis=unit_y)  # -> Geometry, Transform
unit_z = UnitZ(Factor=Slider(-1000, range=-1000..0))
move = Move(Geometry=rotate_3d.Geometry, Motion=unit_z)  # -> Geometry, Transform
unit_x = UnitX(Factor=offset_circles_x)
circle = Circle(Plane=PlaneXY(0, 0, 0), Radius=inner_radius)
move_2 = Move(Geometry=circle, Motion=unit_x)  # -> Geometry, Transform
circle_2 = Circle(Plane=PlaneXY(0, 0, 0), Radius=outer_radius)
colour = Colour(RGB(193, 95, 51))
panel = Panel("Original circles")
project_point = ProjectPoint(Point="0,0,0", Direction=Vector(0, 0, -1), Geometry=move.Geometry)  # -> Point, Index
custom_preview = CustomPreview(Geometry=[circle_2, move_2.Geometry], Material=colour)
panel_2 = Panel(project_point.Point)
deconstruct = Deconstruct(Point=panel_2)  # -> XComponent, YComponent, ZComponent
unit_z_2 = UnitZ(Factor=deconstruct.ZComponent)
reverse = Reverse(Vector=unit_z_2)
move_3 = Move(Geometry=move.Geometry, Motion=reverse)  # -> Geometry, Transform
colour_2 = Colour(RGBA(58, 194, 181, 22))
custom_preview_2 = CustomPreview(Geometry=move_3.Geometry, Material=colour_2)
index = Slider(0, range=0..5)
project = Project(Curve=circle_2, Brep=move_3.Geometry, Direction=Vector(0, 0, 1))
project_2 = Project(Curve=move_2.Geometry, Brep=move_3.Geometry, Direction=Vector(0, 0, 1))
list_item = ListItem(List=project, Index=index, Wrap=True)
list_item_2 = ListItem(List=project_2, Index=index, Wrap=True)
surface_split = SurfaceSplit(Surface=move_3.Geometry, Curves=list_item_2)
number_slider_2 = Slider(1, range=0..1)
surface_split_2 = SurfaceSplit(Surface=move_3.Geometry, Curves=list_item)
list_item_3 = ListItem(List=surface_split, Index=number_slider_2, Wrap=True)
list_item_4 = ListItem(List=surface_split_2, Index=number_slider_2, Wrap=True)

# ----
multiplication = Multiplication(A=number_of_primary_trusses, B=number_of_secondary_trusses)
addition = Addition(A=number_of_primary_trusses, B=multiplication)
circle_3 = Circle(Plane=PlaneXY(0, 0, 0), Radius=outer_radius)
divide_curve = DivideCurve(Curve=circle_3, Count=addition, Kinks=False)  # -> Points, Tangents, Parameters
pi = Pi(Factor=1)
line = Line(StartPoint="0,0,0", EndPoint=divide_curve.Points)
division = Division(A=pi, B=number_of_primary_trusses)
rotate = Rotate(Geometry=line, Angle=division, Plane=PlaneXY(0, 0, 0))  # -> Geometry, Transform

# ---- group: Main grid
addition_2 = Addition(A=number_of_primary_trusses)
circle_4 = Circle(Plane=PlaneXY(0, 0, 0), Radius=outer_radius)
divide_curve_2 = DivideCurve(Curve=circle_4, Count=addition_2, Kinks=False)  # -> Points, Tangents, Parameters
pi_2 = Pi(Factor=1)
line_2 = Line(StartPoint="0,0,0", EndPoint=divide_curve_2.Points)
division_2 = Division(A=pi_2, B=addition_2)
rotate_2 = Rotate(Geometry=line_2, Angle=division_2, Plane=PlaneXY(0, 0, 0))  # -> Geometry, Transform

# ---- group: Secondary Grid
list_length = ListLength(List=rotate.Geometry)
secondary_grids = GhPythonScript(secondary=number_of_secondary_trusses, length=list_length)  # -> out, indices
# ---------- secondary_grids: Python ----------
__author__ = "MullerT"
__version__ = "2022.10.08"

import rhinoscriptsyntax as rs

print(secondary)
print(length)
indices = []

counter = 0
for x in range(length):
    print(x) 
    if x == length:
        break;
    if counter == 0:
        counter = counter+1
        continue
    indices.append(x)
    if counter == secondary:
        counter = 0
    else:
        counter = counter+1



print(indices)
# ---------- end secondary_grids ----------
list_item_5 = ListItem(List=rotate.Geometry, Index=secondary_grids.indices, Wrap=True)

# ---- group: Main grid
list_length_2 = ListLength(List=rotate.Geometry)
addition_3 = Addition(A=number_of_secondary_trusses, B=Slider(1, range=0..1))
division_3 = Division(A=list_length_2, B=Slider(2, range=0..10))
series = Series(Start=0, Step=addition_3, Count=division_3)
list_item_6 = ListItem(List=rotate.Geometry, Index=series, Wrap=True)

# ---- group: Column grid
number_slider_3 = Slider(2, range=0..10)
list_length_3 = ListLength(List=rotate.Geometry)
division_4 = Division(A=list_length_3, B=number_slider_3)
series_2 = Series(Start=0, Step=number_slider_3, Count=division_4)
list_item_7 = ListItem(List=rotate.Geometry, Index=series_2, Wrap=True)

# ----
circle_5 = Circle(Plane=PlaneXY(0, 0, 0), Radius=inner_radius_3)
circle_6 = Circle(Plane=PlaneXY(0, 0, 0), Radius=inner_radius_2)
curve_curve = CurveCurve(CurveA=list_item_7, CurveB=circle_6)  # -> flatten(Points), ParamsA, ParamsB
curve_curve_2 = CurveCurve(CurveA=list_item_7, CurveB=move_2.Geometry)  # -> flatten(Points), ParamsA, ParamsB
curve_curve_3 = CurveCurve(CurveA=list_item_6, CurveB=circle_5)  # -> flatten(Points), ParamsA, ParamsB
boolean_toggle = BooleanToggle(True)
polyline = PolyLine(Vertices=curve_curve_3.Points, Closed=boolean_toggle)
polyline_2 = PolyLine(Vertices=curve_curve_2.Points, Closed=boolean_toggle)
polyline_3 = PolyLine(Vertices=curve_curve.Points, Closed=boolean_toggle)

# ---- group: Seondary grids trimmed
curve_curve_4 = CurveCurve(CurveA=polyline, CurveB=list_item_5)  # -> Points, ParamsA, ParamsB
explode = Explode(Curve=list_item_5, Recursive=True)  # -> Segments, Vertices
curve_curve_5 = CurveCurve(CurveA=polyline_2, CurveB=list_item_5)  # -> Points, ParamsA, ParamsB
list_item_8 = ListItem(List=explode.Vertices, Index=Slider(1, range=0..1), Wrap=True)
line_3 = Line(StartPoint=curve_curve_4.Points, EndPoint=curve_curve_5.Points)

# ----
multiplication_2 = Multiplication(A=truss_depth, B="-1")
project_3 = Project(Curve=polyline_2, Brep=list_item_4, Direction=Vector(0, 0, 1))
project_4 = Project(Curve=polyline, Brep=list_item_4, Direction=Vector(0, 0, 1))
# truss top chord curves
project_5 = Project(Curve=list_item_6, Brep=list_item_4, Direction=Vector(0, 0, 1))
project_6 = Project(Curve=polyline_3, Brep=list_item_4, Direction=Vector(0, 0, 1))
offset_surface = OffsetSurface(Surface=list_item_4, Distance=multiplication_2, Retrim=True)
curve_curve_6 = CurveCurve(CurveA=graft(project_5), CurveB=[project_6, project_4, project_3])  # -> Points, ParamsA, ParamsB
trim_tree = TrimTree(Tree=curve_curve_6.ParamsA, Depth=1)
shatter = Shatter(Curve=graft(project_5), Parameters=trim_tree)
project_7 = Project(Curve=shatter, Brep=offset_surface, Direction=Vector(0, 0, 1))
panel_3 = Panel(shatter)

# ---- group: Secondary trusses
project_8 = Project(Curve=line_3, Brep=list_item_4, Direction=Vector(0, 0, 1))
curve_curve_7 = CurveCurve(CurveA=graft(project_8), CurveB=[project_6, project_4, project_3])  # -> Points, ParamsA, ParamsB
trim_tree_2 = TrimTree(Tree=curve_curve_7.ParamsA, Depth=1)
shatter_2 = Shatter(Curve=graft(project_8), Parameters=trim_tree_2)
sort_duplicate_curves = SortDuplicateCurves(Curves=flatten(shatter_2))  # -> UniqueCurves, Indices
brep_join = BrepJoin(Breps=offset_surface)  # -> Breps, Closed
project_9 = Project(Curve=sort_duplicate_curves.UniqueCurves, Brep=list_item_4, Direction=Vector(0, 0, 1))
project_10 = Project(Curve=sort_duplicate_curves.UniqueCurves, Brep=brep_join.Breps, Direction=Vector(0, 0, 1))
length = Length(Curve=flatten(project_9))
division_5 = Division(A=length, B="1.5")
number_slider_4 = Slider(10, range=0..10)
_2d_truss = _2DTruss(CurveA=flatten(project_9), CurveB=flatten(project_10), Divisions=division_5, TrussToggle=Slider(2, range=0..3))  # -> PrimaryLines, BraceLines, VerticalLines, StructureNodes

# ---- group: RC columns
multiplication_3 = Multiplication(A=column_height, B="-1")
construct_point = ConstructPoint(XCoordinate=0, YCoordinate=0, ZCoordinate=multiplication_3)
multiplication_4 = Multiplication(A=steel_column_length, B="-1")
explode_2 = Explode(Curve=[polyline_3, polyline_2], Recursive=True)  # -> Segments, Vertices
offset_surface_2 = OffsetSurface(Surface=offset_surface, Distance=multiplication_4, Retrim=True)
xy_plane = XYPlane(Origin=construct_point)
unit_z_3 = UnitZ(Factor=1)
project_11 = Project(Geometry=explode_2.Vertices, Plane=xy_plane)  # -> Geometry, Transform
removeduplicatepts = RemoveDuplicatePts(Points=flatten(project_11.Geometry), Tolerance=0.01)
project_point_2 = ProjectPoint(Point=flatten(removeduplicatepts), Direction=unit_z_3, Geometry=offset_surface_2)  # -> Point, Index
line_4 = Line(StartPoint=flatten(removeduplicatepts), EndPoint=project_point_2.Point)

# ---- group: Girders 3
curve_curve_8 = CurveCurve(CurveA=rotate.Geometry, CurveB=polyline_2)  # -> flatten(Points), ParamsA, ParamsB
polyline_4 = PolyLine(Vertices=curve_curve_8.Points, Closed=Toggle(True))
explode_3 = Explode(Curve=polyline_4, Recursive=True)  # -> Segments, Vertices
project_12 = Project(Curve=explode_3.Segments, Brep=list_item_4, Direction=Vector(0, 0, 1))
project_13 = Project(Curve=explode_3.Segments, Brep=offset_surface, Direction=Vector(0, 0, 1))
length_2 = Length(Curve=flatten(project_12))
division_6 = Division(A=length_2, B="3")
number_slider_5 = Slider(10, range=0..10)
_2d_truss_2 = _2DTruss(CurveA=flatten(project_12), CurveB=flatten(project_13), Divisions="3", TrussToggle=Slider(2, range=0..3))  # -> PrimaryLines, BraceLines, VerticalLines, StructureNodes

# ----
split_list = SplitList(List=shatter, Index=Slider(3, range=0..100))  # -> ListA, ListB

# ---- group: Girders 2
curve_curve_9 = CurveCurve(CurveA=rotate.Geometry, CurveB=polyline_3)  # -> flatten(Points), ParamsA, ParamsB
polyline_5 = PolyLine(Vertices=curve_curve_9.Points, Closed=Toggle(True))
explode_4 = Explode(Curve=polyline_5, Recursive=True)  # -> Segments, Vertices
project_14 = Project(Curve=explode_4.Segments, Brep=list_item_4, Direction=Vector(0, 0, 1))
project_15 = Project(Curve=explode_4.Segments, Brep=offset_surface, Direction=Vector(0, 0, 1))
length_3 = Length(Curve=flatten(project_14))
division_7 = Division(A=length_3, B="2")
number_slider_6 = Slider(10, range=0..10)
_2d_truss_3 = _2DTruss(CurveA=flatten(project_14), CurveB=flatten(project_15), Divisions="2", TrussToggle=Slider(2, range=0..3))  # -> PrimaryLines, BraceLines, VerticalLines, StructureNodes

# ---- group: Girders 1
curve_curve_10 = CurveCurve(CurveA=rotate.Geometry, CurveB=polyline)  # -> flatten(Points), ParamsA, ParamsB
polyline_6 = PolyLine(Vertices=curve_curve_10.Points, Closed=Toggle(True))
explode_5 = Explode(Curve=polyline_6, Recursive=True)  # -> Segments, Vertices
project_16 = Project(Curve=explode_5.Segments, Brep=list_item_4, Direction=Vector(0, 0, 1))
project_17 = Project(Curve=explode_5.Segments, Brep=offset_surface, Direction=Vector(0, 0, 1))
length_4 = Length(Curve=flatten(project_16))
division_8 = Division(A=length_4, B="2")
number_slider_7 = Slider(10, range=0..10)
_2d_truss_4 = _2DTruss(CurveA=flatten(project_16), CurveB=flatten(project_17), Divisions="2", TrussToggle=Slider(2, range=0..3))  # -> PrimaryLines, BraceLines, VerticalLines, StructureNodes

# ----
merge = Merge(Data1=split_list.ListA)

# ---- group: Outer trusses
multiplication_5 = Multiplication(A=edge_truss_depth, B="-1")
scale = Scale(Geometry=circle_2, Center=Point(0, 0, 0), Factor=Slider(0.985, range=0..1))  # -> Geometry, Transform
offset_surface_3 = OffsetSurface(Surface=list_item_4, Distance=multiplication_5, Retrim=True)
curve_curve_11 = CurveCurve(CurveA=rotate.Geometry, CurveB=scale.Geometry)  # -> Points, ParamsA, ParamsB
curve_curve_12 = CurveCurve(CurveA=rotate.Geometry, CurveB=polyline_2)  # -> Points, ParamsA, ParamsB
project_point_3 = ProjectPoint(Point=curve_curve_11.Points, Direction=Vector(0, 0, -1), Geometry=offset_surface_3)  # -> Point, Index
project_point_4 = ProjectPoint(Point=curve_curve_12.Points, Direction=Vector(0, 0, -1), Geometry=offset_surface)  # -> Point, Index
project_point_5 = ProjectPoint(Point=curve_curve_12.Points, Direction=Vector(0, 0, -1), Geometry=list_item_4)  # -> Point, Index
project_point_6 = ProjectPoint(Point=curve_curve_11.Points, Direction=Vector(0, 0, -1), Geometry=list_item_4)  # -> Point, Index
line_5 = Line(StartPoint=project_point_4.Point, EndPoint=project_point_3.Point)
line_6 = Line(StartPoint=project_point_5.Point, EndPoint=project_point_6.Point)
_2d_truss_5 = _2DTruss(CurveA=flatten(line_6), CurveB=flatten(line_5), Divisions=Slider(3, range=0..10), TrussToggle=Slider(1, range=0..3))  # -> PrimaryLines, BraceLines, VerticalLines, StructureNodes
merge_2 = Merge(Data1=_2d_truss_4.VerticalLines, Data2=_2d_truss_3.VerticalLines, Data3=_2d_truss_2.VerticalLines)  # -> flatten(Result)
merge_3 = Merge(Data1=_2d_truss_5.VerticalLines)
remove_duplicate_lines = GhPythonScript(input=flatten(merge_3), LinesToRemove=flatten(merge_2))  # -> out, list; inputs input: list of Line, LinesToRemove: list of Line
# ---------- remove_duplicate_lines: Python ----------
__author__ = "MullerT"
__version__ = "2022.10.09"

import rhinoscriptsyntax as rs

def compare_points(x, y):
    #print(range(len(x)))
    tolerance = 0.01
    for i in range(len(x)):
        diff = abs(x[i] - y[i])
        #print("i= "+ str(i) + " xi="+str(x[i]) + " yi="+str(y[i]) +" diff="+str(diff) + " tol: "+str(tolerance) )
        if diff >= tolerance:
            return False
    print("points are equal x "+str(x) + " y: "+str(y))
    return True

def compare_lines(x, y):
  xStart = x[0]
  xEnd = x[1]

  yStart = y[0]
  yEnd = y[1]
  
  if compare_points(xStart, yStart) and  compare_points(xEnd, yEnd):
      return True
  if compare_points(xStart, yEnd) and  compare_points(xEnd, yStart):
      return True

  return False

removeLines  = []
for line in input:
    
    for lr in LinesToRemove:
        
        if compare_lines(line, lr):
            # need to remove
            removeLines.append(line)
            
list = input
numRemove = len(removeLines)
print("# to remove = "+str(numRemove))
for lr in removeLines:
    if lr in list:
        list.remove(lr)
# ---------- end remove_duplicate_lines ----------

# ----
project_18 = Project(Curve=merge, Brep=offset_surface, Direction=Vector(0, 0, 1))

# ---- group: Main trusses
_2d_truss_6 = _2DTruss(CurveA=flatten(merge), CurveB=flatten(project_18), Divisions=Slider(5, range=0..10), TrussToggle=Slider(2, range=0..3))  # -> PrimaryLines, BraceLines, VerticalLines, StructureNodes

# ---- group: Bracing
# Here... remove parts...
merge_4 = Merge(Data1=_2d_truss.StructureNodes)
param_viewer = ParamViewer(merge_4)
panel_4 = Panel("Bracing")
tree_branch = TreeBranch(Tree=merge_4, Path="{0;5}", MaintainPaths=True)
tree_branch_2 = TreeBranch(Tree=merge_4, Path="{0;1}", MaintainPaths=True)
tree_branch_3 = TreeBranch(Tree=merge_4, Path="{0;4}", MaintainPaths=True)
tree_branch_4 = TreeBranch(Tree=merge_4, Path="{0;0}", MaintainPaths=True)
series_3 = Series(Start=Slider(1, range=0..10), Step=Slider(4, range=0..10), Count=10)
list_item_9 = ListItem(List=flatten(tree_branch_4), Index=series_3, Wrap=True)
series_4 = Series(Start=Slider(1, range=0..10), Step=Slider(4, range=0..10), Count=10)
list_item_10 = ListItem(List=flatten(tree_branch_3), Index=series_4, Wrap=True)
series_5 = Series(Start=0, Step=Slider(4, range=0..10), Count=10)
list_item_11 = ListItem(List=flatten(tree_branch_3), Index=series_5, Wrap=True)
series_6 = Series(Start=0, Step=Slider(4, range=0..10), Count=10)
list_item_12 = ListItem(List=flatten(tree_branch_4), Index=series_6, Wrap=True)
construct_domain = ConstructDomain(DomainStart=0, DomainEnd=Slider(3, range=0..10))
construct_domain_2 = ConstructDomain(DomainStart=0, DomainEnd=Slider(3, range=0..10))
construct_domain_3 = ConstructDomain(DomainStart=0, DomainEnd=Slider(3, range=0..10))
construct_domain_4 = ConstructDomain(DomainStart=0, DomainEnd=Slider(3, range=0..10))
sub_list = SubList(List=flatten(list_item_9), Domain=construct_domain_4, Wrap=True)  # -> List, Index
sub_list_2 = SubList(List=flatten(list_item_10), Domain=construct_domain, Wrap=True)  # -> List, Index
sub_list_3 = SubList(List=flatten(list_item_12), Domain=construct_domain_2, Wrap=True)  # -> List, Index
sub_list_4 = SubList(List=flatten(list_item_11), Domain=construct_domain_3, Wrap=True)  # -> List, Index
weave = Weave(Pattern=[0, 1], Stream0=sub_list_3.List, Stream1=sub_list_4.List, NullGaps=False)
weave_2 = Weave(Pattern=[0, 1], Stream0=sub_list_4.List, Stream1=sub_list_3.List, NullGaps=False)
weave_3 = Weave(Pattern=[0, 1], Stream0=sub_list.List, Stream1=sub_list_2.List, NullGaps=False)
weave_4 = Weave(Pattern=[0, 1], Stream0=sub_list_2.List, Stream1=sub_list.List, NullGaps=False)
polyline_7 = PolyLine(Vertices=weave, Closed=False)
polyline_8 = PolyLine(Vertices=weave_2, Closed=False)
polyline_9 = PolyLine(Vertices=weave_4, Closed=False)
polyline_10 = PolyLine(Vertices=weave_3, Closed=False)
merge_5 = Merge(Data1=polyline_10, Data2=polyline_9)
merge_6 = Merge(Data1=_2d_truss_3.PrimaryLines, Data2=_2d_truss_4.PrimaryLines)
explode_6 = Explode(Curve=merge_5, Recursive=True)  # -> Segments, Vertices
removeduplicatelines = RemoveDuplicateLines(Lines=explode_6.Segments, Tolerance=0.01)
list_item_13 = ListItem(List=flatten(removeduplicatelines), Index=Slider(9, range=0..30), Wrap=True)
remove_coincident_lines = GhPythonScript(input=flatten(explode_6.Segments), LinesToRemove=flatten(merge_6))  # -> out, list, removeLines; inputs input: list of Line, LinesToRemove: list of Line
# ---------- remove_coincident_lines: Python ----------
__author__ = "MullerT"
__version__ = "2022.10.09"

import rhinoscriptsyntax as rs

def compare_points(x, y):
    #print(range(len(x)))
    tolerance = 0.01
    for i in range(len(x)):
        diff = abs(x[i] - y[i])
        #print("i= "+ str(i) + " xi="+str(x[i]) + " yi="+str(y[i]) +" diff="+str(diff) + " tol: "+str(tolerance) )
        if diff >= tolerance:
            return False
    print("points are equal x "+str(x) + " y: "+str(y))
    return True

def pointOn3D_line(line, point):
    startPoint = line[0]
    endPoint = line[1]
    
    t = []
    #loop throuh line ang get t values
    for i in range(3):
        if abs(endPoint[i] - startPoint[i]) > 0:
            ti = (point[i] - startPoint[i] )/(endPoint[i] - startPoint[i])
            t.append(ti);
    
    print("t values = "+str(t))
    t0 = t[0]
    tolerance = 0.01
    for i in range(len(t)):
        if i == 0:
            continue
        if abs(t0 - t[i]) > tolerance:
            #print("point is NOT on line")
            return False
    print("point IS on line t: "+str(t))
    return True

removeLines  = []
for line in input:
    
    for lr in LinesToRemove:
        
        if compare_points(line[0], lr[0]) or compare_points(line[1], lr[1]) or compare_points(line[0], lr[1]) or compare_points(line[1], lr[1]):
            print("lines have same points - need to remove")
            removeLines.append(line)
            continue
        
        if pointOn3D_line(line, lr[0]) and pointOn3D_line(line, lr[1]):
            print("both points on line - need to remove")
            # need to remove
            removeLines.append(line)
            
list = input
numRemove = len(removeLines)
print("# to remove = "+str(numRemove))
for lr in removeLines:
    if lr in list:
        list.remove(lr)
# ---------- end remove_coincident_lines ----------
panel_5 = Panel("""0
6""")
cull_index = CullIndex(List=flatten(removeduplicatelines), Indices=panel_5, Wrap=True)
section_filter = SectionFilter(
    DepthMm=Domain(0, 0),
    MassKgM=Domain(0, 0),
    AreaMm²=Domain(0, 0),
    InertiaCm⁴=Domain(0, 0),
    PlasticModulusCm³=Domain(0, 0),
    ElasticModulusCm³=Domain(0, 0),
    Integer=3,
    CustomTimeout=3,
    HasTimeoutInputParameter=True,
    HasTsdData=True,
    SectionGroupName="UKSteelSections_CircularHollowSections")  # -> Sections, SelectedSection
sort_duplicate_curves_2 = SortDuplicateCurves(Curves=flatten(cull_index))  # -> UniqueCurves, Indices
steel_brace = SteelBrace(
    InsertionLine=sort_duplicate_curves_2.UniqueCurves,
    SteelGrade="S355",
    Section=section_filter.SelectedSection,
    TensionOnly=False)
merge_7 = Merge(Data1=steel_brace)

# ----
project_point_7 = ProjectPoint(Point=flatten(project_point_2.Point), Direction=unit_z_3, Geometry=list_item_4)  # -> Point, Index
line_7 = Line(StartPoint=flatten(project_point_2.Point), EndPoint=flatten(project_point_7.Point))
merge_8 = Merge(Data1=_2d_truss_3.VerticalLines)
merge_9 = Merge(Data1=_2d_truss_2.VerticalLines)
member_alignment = MemberAlignment(MajorOffsetMm=0, MinorOffsetMm=0)

# ---- group: Outer beam
polyline_11 = PolyLine(Vertices=flatten(project_point_6.Point), Closed=Toggle(True))
explode_7 = Explode(Curve=polyline_11, Recursive=True)  # -> Segments, Vertices
section_filter_2 = SectionFilter(
    DepthMm=Domain(0, 0),
    MassKgM=Domain(0, 0),
    AreaMm²=Domain(0, 0),
    InertiaCm⁴=Domain(0, 0),
    PlasticModulusCm³=Domain(0, 0),
    ElasticModulusCm³=Domain(0, 0),
    HasTsdData=True,
    SectionGroupName="UKSteelSections_AdvanceUKB")  # -> Sections, SelectedSection
sort_duplicate_curves_3 = SortDuplicateCurves(Curves=flatten(explode_7.Segments))  # -> UniqueCurves, Indices
steel_beam = SteelBeam(
    InsertionLine=sort_duplicate_curves_3.UniqueCurves,
    Composite=False,
    SteelGrade="S355",
    Section=section_filter_2.SelectedSection,
    MemberAlignment=member_alignment,
    ReleasesEnd1=[True, True, True, True, False, False],
    ReleasesEnd2=[True, True, True, True, False, False],
    RotationAngle=0)

# ----
remove_coincident_lines_2 = GhPythonScript(input=flatten(merge_9), LinesToRemove=flatten(line_7))  # -> out, list, removeLines; inputs input: list of Line, LinesToRemove: list of Line; same code as remove_coincident_lines
remove_coincident_lines_3 = GhPythonScript(input=flatten(merge_8), LinesToRemove=flatten(line_7))  # -> out, list, removeLines; inputs input: list of Line, LinesToRemove: list of Line; same code as remove_coincident_lines
merge_10 = Merge(Data1=flatten(remove_coincident_lines_2.removeLines))
merge_11 = Merge(Data1=_2d_truss_4.VerticalLines, Data2=_2d_truss_3.VerticalLines, Data3=_2d_truss_2.VerticalLines)  # -> flatten(Result)
merge_12 = Merge(Data1=_2d_truss.VerticalLines)
merge_13 = Merge(Data1=flatten(remove_coincident_lines_3.removeLines))
deconstruct_2 = Deconstruct(Point=project_point_7.Point)  # -> XComponent, YComponent, ZComponent
merge_14 = Merge(Data1=_2d_truss_4.VerticalLines, Data2=_2d_truss_3.VerticalLines, Data3=_2d_truss_2.VerticalLines)  # -> flatten(Result)
merge_15 = Merge(Data1=_2d_truss_6.VerticalLines)
remove_duplicate_lines_2 = GhPythonScript(input=flatten(merge_12), LinesToRemove=flatten(merge_11))  # -> out, list; inputs input: list of Line, LinesToRemove: list of Line; same code as remove_duplicate_lines
construct_point_2 = ConstructPoint(XCoordinate=deconstruct_2.XComponent, YCoordinate=deconstruct_2.YComponent, ZCoordinate=0)
construct_point_3 = ConstructPoint(XCoordinate=0, YCoordinate=0, ZCoordinate=0)
remove_duplicate_lines_3 = GhPythonScript(input=flatten(merge_15), LinesToRemove=flatten(merge_14))  # -> out, list; inputs input: list of Line, LinesToRemove: list of Line; same code as remove_duplicate_lines
unit_x_2 = UnitX(Factor=1)
line_8 = Line(StartPoint=construct_point_3, EndPoint=construct_point_2)
member_alignment_2 = MemberAlignment(MajorOffsetMm=0, MinorOffsetMm=0)
member_alignment_3 = MemberAlignment(MajorOffsetMm=0, MinorOffsetMm=0)
member_alignment_4 = MemberAlignment(MajorOffsetMm=0, MinorOffsetMm=0)
member_alignment_5 = MemberAlignment(MajorOffsetMm=0, MinorOffsetMm=0)
member_alignment_6 = MemberAlignment(MajorOffsetMm=0, MinorOffsetMm=0)
member_alignment_7 = MemberAlignment(MajorOffsetMm=0, MinorOffsetMm=0)
angle = Angle(VectorA=line_8, VectorB=unit_x_2)  # -> Angle, Reflex
panel_6 = Panel("""True
True
True
True
True
True""")
section_filter_3 = SectionFilter(
    DepthMm=Domain(0, 0),
    MassKgM=Domain(0, 0),
    AreaMm²=Domain(0, 0),
    InertiaCm⁴=Domain(0, 0),
    PlasticModulusCm³=Domain(0, 0),
    ElasticModulusCm³=Domain(0, 0),
    HasTsdData=True,
    SectionGroupName="UKSteelSections_AdvanceUKB")  # -> Sections, SelectedSection
section_filter_4 = SectionFilter(
    DepthMm=Domain(0, 0),
    MassKgM=Domain(0, 0),
    AreaMm²=Domain(0, 0),
    InertiaCm⁴=Domain(0, 0),
    PlasticModulusCm³=Domain(0, 0),
    ElasticModulusCm³=Domain(0, 0),
    HasTsdData=True,
    SectionGroupName="UKSteelSections_AdvanceUKC")  # -> Sections, SelectedSection
section_filter_5 = SectionFilter(
    DepthMm=Domain(0, 0),
    MassKgM=Domain(0, 0),
    AreaMm²=Domain(0, 0),
    InertiaCm⁴=Domain(0, 0),
    PlasticModulusCm³=Domain(0, 0),
    ElasticModulusCm³=Domain(0, 0),
    HasTsdData=True,
    SectionGroupName="UKSteelSections_AdvanceUKB")  # -> Sections, SelectedSection
sort_duplicate_curves_4 = SortDuplicateCurves(Curves=flatten(_2d_truss_5.PrimaryLines))  # -> UniqueCurves, Indices
sort_duplicate_curves_5 = SortDuplicateCurves(Curves=flatten(_2d_truss_2.PrimaryLines))  # -> UniqueCurves, Indices
section_filter_6 = SectionFilter(
    DepthMm=Domain(0, 0),
    MassKgM=Domain(0, 0),
    AreaMm²=Domain(0, 0),
    InertiaCm⁴=Domain(0, 0),
    PlasticModulusCm³=Domain(0, 0),
    ElasticModulusCm³=Domain(0, 0),
    HasTsdData=True,
    SectionGroupName="UKSteelSections_CircularHollowSections")  # -> Sections, SelectedSection
section_filter_7 = SectionFilter(
    DepthMm=Domain(0, 0),
    MassKgM=Domain(0, 0),
    AreaMm²=Domain(0, 0),
    InertiaCm⁴=Domain(0, 0),
    PlasticModulusCm³=Domain(0, 0),
    ElasticModulusCm³=Domain(0, 0),
    Integer=3,
    CustomTimeout=3,
    HasTimeoutInputParameter=True,
    HasTsdData=True,
    SectionGroupName="UKSteelSections_CircularHollowSections")  # -> Sections, SelectedSection
section_filter_8 = SectionFilter(
    DepthMm=Domain(0, 0),
    MassKgM=Domain(0, 0),
    AreaMm²=Domain(0, 0),
    InertiaCm⁴=Domain(0, 0),
    PlasticModulusCm³=Domain(0, 0),
    ElasticModulusCm³=Domain(0, 0),
    HasTsdData=True,
    SectionGroupName="UKSteelSections_AdvanceUKB")  # -> Sections, SelectedSection
section_filter_9 = SectionFilter(
    DepthMm=Domain(0, 0),
    MassKgM=Domain(0, 0),
    AreaMm²=Domain(0, 0),
    InertiaCm⁴=Domain(0, 0),
    PlasticModulusCm³=Domain(0, 0),
    ElasticModulusCm³=Domain(0, 0),
    Integer=3,
    CustomTimeout=3,
    HasTimeoutInputParameter=True,
    HasTsdData=True,
    SectionGroupName="UKSteelSections_CircularHollowSections")  # -> Sections, SelectedSection
section_filter_10 = SectionFilter(
    DepthMm=Domain(0, 0),
    MassKgM=Domain(0, 0),
    AreaMm²=Domain(0, 0),
    InertiaCm⁴=Domain(0, 0),
    PlasticModulusCm³=Domain(0, 0),
    ElasticModulusCm³=Domain(0, 0),
    Integer=3,
    CustomTimeout=3,
    HasTimeoutInputParameter=True,
    HasTsdData=True,
    SectionGroupName="UKSteelSections_CircularHollowSections")  # -> Sections, SelectedSection
sort_duplicate_curves_6 = SortDuplicateCurves(Curves=flatten([_2d_truss_2.BraceLines, remove_coincident_lines_2.list]))  # -> UniqueCurves, Indices
degrees = Degrees(Radians=angle.Angle)
section_filter_11 = SectionFilter(
    DepthMm=Domain(0, 0),
    MassKgM=Domain(0, 0),
    AreaMm²=Domain(0, 0),
    InertiaCm⁴=Domain(0, 0),
    PlasticModulusCm³=Domain(0, 0),
    ElasticModulusCm³=Domain(0, 0),
    Integer=3,
    CustomTimeout=3,
    HasTimeoutInputParameter=True,
    HasTsdData=True,
    SectionGroupName="UKSteelSections_CircularHollowSections")  # -> Sections, SelectedSection
section_filter_12 = SectionFilter(
    DepthMm=Domain(0, 0),
    MassKgM=Domain(0, 0),
    AreaMm²=Domain(0, 0),
    InertiaCm⁴=Domain(0, 0),
    PlasticModulusCm³=Domain(0, 0),
    ElasticModulusCm³=Domain(0, 0),
    HasTsdData=True,
    SectionGroupName="UKSteelSections_AdvanceUKB")  # -> Sections, SelectedSection
section_filter_13 = SectionFilter(
    DepthMm=Domain(0, 0),
    MassKgM=Domain(0, 0),
    AreaMm²=Domain(0, 0),
    InertiaCm⁴=Domain(0, 0),
    PlasticModulusCm³=Domain(0, 0),
    ElasticModulusCm³=Domain(0, 0),
    HasTsdData=True,
    SectionGroupName="UKSteelSections_AdvanceUKB")  # -> Sections, SelectedSection
sort_duplicate_curves_7 = SortDuplicateCurves(Curves=flatten([_2d_truss_5.BraceLines, remove_duplicate_lines.list]))  # -> UniqueCurves, Indices
section_filter_14 = SectionFilter(
    DepthMm=Domain(0, 0),
    MassKgM=Domain(0, 0),
    AreaMm²=Domain(0, 0),
    InertiaCm⁴=Domain(0, 0),
    PlasticModulusCm³=Domain(0, 0),
    ElasticModulusCm³=Domain(0, 0),
    Integer=3,
    CustomTimeout=3,
    HasTimeoutInputParameter=True,
    HasTsdData=True,
    SectionGroupName="UKSteelSections_CircularHollowSections")  # -> Sections, SelectedSection
section_filter_15 = SectionFilter(
    DepthMm=Domain(0, 0),
    MassKgM=Domain(0, 0),
    AreaMm²=Domain(0, 0),
    InertiaCm⁴=Domain(0, 0),
    PlasticModulusCm³=Domain(0, 0),
    ElasticModulusCm³=Domain(0, 0),
    HasTsdData=True,
    SectionGroupName="UKSteelSections_AdvanceUKB")  # -> Sections, SelectedSection
sort_duplicate_curves_8 = SortDuplicateCurves(Curves=flatten(_2d_truss_3.PrimaryLines))  # -> UniqueCurves, Indices
panel_7 = Panel("""True
True
True
True
True
True""")
sort_duplicate_curves_9 = SortDuplicateCurves(Curves=flatten(_2d_truss_4.PrimaryLines))  # -> UniqueCurves, Indices
sort_duplicate_curves_10 = SortDuplicateCurves(Curves=flatten(_2d_truss_6.PrimaryLines))  # -> UniqueCurves, Indices
sort_duplicate_curves_11 = SortDuplicateCurves(Curves=flatten([_2d_truss_3.BraceLines, remove_coincident_lines_3.list]))  # -> UniqueCurves, Indices
sort_duplicate_curves_12 = SortDuplicateCurves(Curves=flatten([_2d_truss_6.BraceLines, remove_duplicate_lines_3.list]))  # -> UniqueCurves, Indices
sort_duplicate_curves_13 = SortDuplicateCurves(Curves=flatten(_2d_truss.PrimaryLines))  # -> UniqueCurves, Indices
panel_8 = Panel("""True
True
True
True
True
True""")
panel_9 = Panel("""True
True
True
True
True
True""")
sort_duplicate_curves_14 = SortDuplicateCurves(Curves=flatten([_2d_truss.BraceLines, remove_duplicate_lines_2.list]))  # -> UniqueCurves, Indices
panel_10 = Panel("""True
True
True
True
True
True""")
panel_11 = Panel("""True
True
True
True
True
True""")
removeduplicatelines_2 = RemoveDuplicateLines(Lines=flatten([_2d_truss_4.BraceLines, _2d_truss_4.VerticalLines]), Tolerance=0.01)
concrete_column = ConcreteColumn(
    InsertionLine=line_4,
    Precast=False,
    ConcreteClass="C32/40",
    Section="800x800",
    RotationAngle=0,
    AssumeCracked=True,
    AddSupport=True)
steel_column = SteelColumn(
    InsertionLine=line_7,
    SteelGrade="S355",
    Section=section_filter_4.SelectedSection,
    ReleasesEnd1=[True, True, True, True, True, True],
    ReleasesEnd2=[True, True, True, True, True, True],
    RotationAngle=degrees,
    AddSupport=Toggle(False))
steel_beam_2 = SteelBeam(
    InsertionLine=sort_duplicate_curves_4.UniqueCurves,
    Composite=False,
    SteelGrade="S355",
    Section=section_filter_3.SelectedSection,
    MemberAlignment=member_alignment_2,
    ReleasesEnd1=panel_6,
    ReleasesEnd2=panel_6,
    RotationAngle=0)
steel_brace_2 = SteelBrace(
    InsertionLine=sort_duplicate_curves_7.UniqueCurves,
    SteelGrade="S355",
    Section=section_filter_6.SelectedSection,
    TensionOnly=False)
steel_brace_3 = SteelBrace(
    InsertionLine=sort_duplicate_curves_6.UniqueCurves,
    SteelGrade="S355",
    Section=section_filter_7.SelectedSection,
    TensionOnly=False)
steel_brace_4 = SteelBrace(
    InsertionLine=sort_duplicate_curves_11.UniqueCurves,
    SteelGrade="S355",
    Section=section_filter_10.SelectedSection,
    TensionOnly=False)
steel_beam_3 = SteelBeam(
    InsertionLine=sort_duplicate_curves_5.UniqueCurves,
    Composite=False,
    SteelGrade="S355",
    Section=section_filter_5.SelectedSection,
    MemberAlignment=member_alignment_5,
    ReleasesEnd1=panel_7,
    ReleasesEnd2=panel_7,
    RotationAngle=Slider(90, range=0..100))
steel_brace_5 = SteelBrace(
    InsertionLine=sort_duplicate_curves_12.UniqueCurves,
    SteelGrade="S355",
    Section=section_filter_11.SelectedSection,
    TensionOnly=False)
steel_brace_6 = SteelBrace(InsertionLine=removeduplicatelines_2, SteelGrade="S355", Section=section_filter_14.SelectedSection, TensionOnly=False)
steel_brace_7 = SteelBrace(
    InsertionLine=sort_duplicate_curves_14.UniqueCurves,
    SteelGrade="S355",
    Section=section_filter_9.SelectedSection,
    TensionOnly=False)
steel_beam_4 = SteelBeam(
    InsertionLine=sort_duplicate_curves_8.UniqueCurves,
    Composite=False,
    SteelGrade="S355",
    Section=section_filter_8.SelectedSection,
    MemberAlignment=member_alignment_3,
    ReleasesEnd1=panel_10,
    ReleasesEnd2=panel_10,
    RotationAngle=Slider(90, range=0..100))
steel_beam_5 = SteelBeam(
    InsertionLine=sort_duplicate_curves_10.UniqueCurves,
    Composite=False,
    SteelGrade="S355",
    Section=section_filter_13.SelectedSection,
    MemberAlignment=member_alignment_4,
    ReleasesEnd1=panel_8,
    ReleasesEnd2=panel_8,
    RotationAngle=Slider(90, range=0..100))
steel_beam_6 = SteelBeam(
    InsertionLine=sort_duplicate_curves_9.UniqueCurves,
    Composite=False,
    SteelGrade="S355",
    Section=section_filter_12.SelectedSection,
    MemberAlignment=member_alignment_7,
    ReleasesEnd1=panel_11,
    ReleasesEnd2=panel_11,
    RotationAngle=Slider(90, range=0..100))
steel_beam_7 = SteelBeam(
    InsertionLine=sort_duplicate_curves_13.UniqueCurves,
    Composite=False,
    SteelGrade="S355",
    Section=section_filter_15.SelectedSection,
    MemberAlignment=member_alignment_6,
    ReleasesEnd1=panel_9,
    ReleasesEnd2=panel_9,
    RotationAngle=Slider(90, range=0..100))
merge_16 = Merge(Data1=concrete_column, Data2=steel_column)
merge_17 = Merge(Data1=steel_beam_7, Data2=steel_brace_7)
merge_18 = Merge(Data1=steel_beam, Data2=steel_brace_2, Data3=steel_beam_2)
merge_19 = Merge(Data1=steel_beam_5, Data2=steel_brace_5)
merge_20 = Merge(Data1=steel_beam_4, Data2=steel_brace_4)
merge_21 = Merge(Data1=steel_beam_3, Data2=steel_brace_3)
merge_22 = Merge(Data1=steel_beam_6, Data2=steel_brace_6)
merge_23 = Merge(Data1=merge_17, Data2=merge_22, Data3=merge_20, Data4=merge_21, Data5=merge_19, Data6=merge_16, Data7=merge_18)

# ---- group: Loads
merge_24 = Merge(Data1=steel_beam_2, Data2=steel_beam_5, Data3=steel_beam_7, Data4=steel_beam_6, Data5=steel_beam_4, Data6=steel_beam_3)
member_point_load = MemberPointLoad(Member=merge_24, ValueKN=Slider(15, range=0..100), Position=Slider(0, range=0..1), Relative=True)
loadcase = Loadcase(Title="Link", IncludeInGenerator=True, ImposedLoadReductions=True, MemberLoads=flatten(member_point_load))

# ----
self_weight_loadcases = SelfWeightLoadcases()  # -> SelfWeightExcludingSlabs, SlabSelfWeight, SlabWet
factored_loadcase = FactoredLoadcase(Loadcase=loadcase, Factor1="1.6", Factor2="1.1", Factor3="1.1")
factored_loadcase_2 = FactoredLoadcase(Loadcase=self_weight_loadcases.SlabSelfWeight, Factor1="1.2", Factor2="1.1", Factor3="1.1")
factored_loadcase_3 = FactoredLoadcase(Loadcase=self_weight_loadcases.SlabWet, Factor1="1.2", Factor2="1.1", Factor3="1.1")
factored_loadcase_4 = FactoredLoadcase(Loadcase=self_weight_loadcases.SelfWeightExcludingSlabs, Factor1="1.2", Factor2="1.1", Factor3="1.1")
merge_25 = Merge(Data1=factored_loadcase, Data2=factored_loadcase_4, Data3=factored_loadcase_2, Data4=factored_loadcase_3)
combination = Combination(Title="Comb 1", Active=True, Pattern=False, Strength=True, Service=True, Loadcases=flatten(merge_25))
# TODO
# bracing TC and BC
# 
# focus on TSD modelling quality
# 
# 
# 
# refine script - some things will likely break when changing input?
# 
# KLAAR!
model = Model(LineElements=flatten(merge_23), Loading=flatten(combination), HasTsdData=True)  # -> Model, Loading
analysis = Analysis(Loading=flatten(combination))  # -> AnalysisInfo, Loading
design_subject = DesignSubject()
design_type = DesignType()
design = Design(Subject=design_subject, Type=design_type)  # -> Outcome, AnalysisInfo, Results
global_nodal_displacements = GlobalNodalDisplacements(AnalysisInfo=analysis.AnalysisInfo, Loading=analysis.Loading)  # -> MaxDisplacementsMm, MinDisplacementsMm
object_type = ObjectType()
steel_model_quantities = SteelModelQuantities(Design=design.Outcome, ObjectType=object_type)  # -> No, NoOfConnectors, MassKg, SurfaceAreaM², EmbodiedCarbonMassKgCO₂e
member_design_results = MemberDesignResults(Results=design.Results, Member=merge_23)  # -> MemberStatus, MemberUR, SpanStatuses, SpanURs
panel_12 = Panel(design.AnalysisInfo)
panel_13 = Panel(global_nodal_displacements.MaxDisplacementsMm)
panel_14 = Panel(global_nodal_displacements.MinDisplacementsMm)
panel_15 = Panel(member_design_results.MemberStatus)
panel_16 = Panel(member_design_results.MemberUR)
panel_17 = Panel(member_design_results.SpanStatuses)
panel_18 = Panel(member_design_results.SpanURs)
panel_19 = Panel(steel_model_quantities.No)
panel_20 = Panel(steel_model_quantities.MassKg)
panel_21 = Panel(steel_model_quantities.EmbodiedCarbonMassKgCO₂e)
panel_22 = Panel(steel_model_quantities.SurfaceAreaM²)
